vi "Main.gviweb"   [LabVIEW NXG 2.0.0]
panel indicators:
  "Observed Data and Fitted Curve": cluster{"Element 1": f64, "Element 2": f64}[][]
  "Sequence Pass/Fail": bool
  "Test Sequence Results": T1[]
  "URL Image": string
types:
  T1 = cluster{"Bandwidth (MHz)": f64, "SNR": f64, "Power Consumption %": f64, "Step Pass?": bool}
uses:
  Application::Get Tag.gviweb
diagram:
  s1 = [FALSE, FALSE, FALSE, FALSE, FALSE, FALSE, FALSE, TRUE]  # shift register
  s2 = T1[] []  # shift register
  while (iteration -> i1) {
    Wait(time to wait=250)
    call "Get Tag.gviweb"(Host="ec2-54-88-212-163.compute-1.amazonaws.com") -> (Array=w1, Array_2=w2, Observed Data and Fitted Curve=w3)
    call "Aggregate Test Data.gviweb"(Array=s1, Array_3=s2, Array_5=w1, Array_2=w2, Numeric=i1) -> (Array_4=w4, Sequence Pass/Fail=w5, Test Sequence Results=w6)
    $"Sequence Pass/Fail" <- w5
    $"Test Sequence Results" <- w6
    $"Observed Data and Fitted Curve" <- w3
    next s1 = w4
    next s2 = w6
    stop if FALSE
  }
